# Grasshopper definition Workbench_GLTF_Export.ghx (Grasshopper 1.0.8)
# Copyright: 2021
# plug-ins: RhinoCodePluginGH, Web_Exporter

# ---- group: scene
number_slider = Slider(0.498, range=0..1)
number_slider_2 = Slider(20, range=0..100)
multiplication = Multiplication(A=number_slider, B=Slider(4.709, range=0..10))
box = CenterBox(Base=PlaneXY(9.548302899, 20.53808267, 0), X=number_slider, Y=number_slider, Z=number_slider)
rectangle = Rectangle(Plane=PlaneXY(0, 0, 0), XSize=multiplication, YSize=multiplication, Radius=0)  # -> Rectangle, Length
arrrec = RectangularArray(Geometry=box, Cell=rectangle.Rectangle, XCount=number_slider_2, YCount=number_slider_2)  # -> Geometry, Transform

# ----
gltfoptions = GltfOptions(
    CullBackfaces=True,
    DracoCompressionLevel=10,
    DracoQuantizationBitsNormal=8,
    DracoQuantizationBitsPosition=11,
    DracoQuantizationBitsTextureCoordinate=10,
    ExportLayers=False,
    ExportMaterials=True,
    ExportOpenMeshes=True,
    ExportTextureCoordinates=True,
    ExportVertexColors=True,
    ExportVertexNormals=True,
    MapZToY=True,
    SubDMeshType=0,
    SubDSurfaceMeshingDensity=4,
    UseDisplayColorForUnsetMaterials=True,
    UseDracoCompression=True)  # -> FileGltfWriteOptions, ArchivableDictionary

# ---- group: materials
materials = QueryModelMaterials(AutoUpdateState=True)
data = Data({ContentXML="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", Path="PBM Corian - DuPont"})
material = ModelMaterial(Material=materials)  # -> Material, Name, Shader
panel = Panel(material.Name)
item = ListItem(List=material.Name, Index=0, Wrap=True)  # -> Item, Item1

# ----
data_2 = Data({ContentXML="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", Path="CustMatMatch"})

# ---- group: Geometry
geo = Geometry(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)
mbox = MeshBox(Base=geo, XCount=10, YCount=10, ZCount=10)

# ----
bang = ExplodeTree(Data=graft(material.Name))  # -> Branch0, Branch1, Branch2, Branch3
entwine = Entwine(Branch00=[bang.Branch0, bang.Branch1, bang.Branch2], Branch01=bang.Branch3, FlattenInputs=True)
export = Button()

# ---- group: Read Settings
panel_2 = Panel(gltfoptions.ArchivableDictionary)

# ----
bake = Button()

# ---- group: populate scene (optional)
S = Script(geo=arrrec.Geometry, bake=bake)  # -> out; inputs geo: GeometryBase, bake: Boolean
# ---------- S: C# ----------
// Grasshopper Script Instance
#region Usings
using System;
using System.Linq;
using System.Collections;
using System.Collections.Generic;
using System.Drawing;

using Rhino;
using Rhino.Geometry;

using Grasshopper;
using Grasshopper.Kernel;
using Grasshopper.Kernel.Data;
using Grasshopper.Kernel.Types;
#endregion

public class Script_Instance : GH_ScriptInstance
{
    #region Notes
    /* 
      Members:
        RhinoDoc RhinoDocument
        GH_Document GrasshopperDocument
        IGH_Component Component
        int Iteration

      Methods (Virtual & overridable):
        Print(string text)
        Print(string format, params object[] args)
        Reflect(object obj)
        Reflect(object obj, string method_name)
    */
    #endregion

    private void RunScript(GeometryBase geo, bool bake)
    {
        var att = new Rhino.DocObjects.ObjectAttributes();
        att.Name = RhinoDocument.Layers.CurrentLayer.Name;
        att.LayerIndex = RhinoDocument.Layers.CurrentLayerIndex;
        att.ColorSource = Rhino.DocObjects.ObjectColorSource.ColorFromLayer;
        att.ObjectColor = System.Drawing.Color.Beige;
        
        if (bake){
            var guid = RhinoDoc.ActiveDoc.Objects.Add(geo, att);
            Print("Baked object with GUID: " + guid.ToString());
        }
    }
}
# ---------- end S ----------

# ----
panel_3 = Panel(S)

# ---- group: multiple Geometries
number_slider_3 = Slider(0.37, range=0..1)
pt = ConstructPoint(XCoordinate=Slider(-18, range=-60..21), YCoordinate=0, ZCoordinate=0)
number_slider_4 = Slider(3, range=0..100)
box_2 = CenterBox(Base=pt, X=number_slider_3, Y=number_slider_3, Z=number_slider_3)
area = Area(Geometry=box_2)  # -> Area, Centroid
scale = Scale(Geometry=box_2, Center=area.Centroid, Factor=Slider(1.2, range=0..10))  # -> Geometry, Transform
arrbox = BoxArray(Geometry=box_2, Cell=scale.Geometry, XCount=number_slider_4, YCount=number_slider_4, ZCount=number_slider_4)  # -> Geometry, Transform

# ----
partition = PartitionList(List=arrbox.Geometry, Size=number_slider_4)

# ---- group: multiple Geometries (continued)
mbox_2 = MeshBox(Base=partition, XCount="1", YCount="1", ZCount="1")

# ----
gltfexporter = GltfExporter(
    Export=export,
    FileName="model_04(VS)",
    Folder="C:\Data\CloudFlare\3d-models\ReceivingGH_GLTFs",
    GeometryCollection=mbox_2,
    MaterialName=entwine,
    FileGltfWriteOptions=gltfoptions.FileGltfWriteOptions)
panel_4 = Panel(gltfexporter)
